% Simulink data dictionary Trike_dictionary.sldd

APT_RPDOs = Simulink.Bus()
  StatusWord: uint8
  PhaseCurrent: int16
  Speed: int16
  BusVoltage: uint16
  MotorTemp: int8
  APTTemp: int8
  ErrStatus: uint8
  Direction: uint8

Joystick_RPDOs = Simulink.Bus()
  ButtonsStatus: uint8
  LongCmp: single
  LatCmd: single

Dunk_RPDOs = Simulink.Bus()
  StatusWord: uint16
  OperationMode: int8
  TargetTorque: int16
  ActualTorque: int16
  TargetVelocity: int32
  ActualVelocity: int32
  TargetPosition: int32
  ActualPosition: int32
  CurrentActualValue: int16
  VdclinkActualValue: uint32
  MotorTempActualValue: int16

Speedgoat_TPDOs = Simulink.Bus()
  APT_ControlWord: uint8
  APT_PedalPosition: uint8
  APT_HeartBeat: uint8
  DunkA_ControlWord: uint16
  DunkA_OperationMode: int8
  DunkA_TargetTorque: int16
  DunkA_TargetVelocity: int32
  DunkA_TargetPosition: int32
  DunkA_BrakeControl: int16

DunkA_RPDOs = Simulink.Bus()
  StatusWord: uint16
  OperationMode: int8
  TargetTorque: int16
  ActualTorque: int16
  TargetVelocity: int32
  ActualVelocity: int32
  TargetPosition: int32
  ActualPosition: int32
  CurrentActualValue: int16
  VdclinkActualValue: uint32
  MotorTempActualValue: int16

AN2CAN_conv = Simulink.Bus()
  Channel_AN1: uint16
  Channel_AN2: uint16
  Channel_AN3: uint16
  Channel_AN4: uint16